# Grasshopper definition TileEvaluator.gh (Grasshopper 1.0.8)

face_plane = GetPlane(AtLeast=1, AtMost=1, Realtime=True, TreeAccess=False)
tile_w = GetNumber(AtLeast=1, AtMost=1, Maximum=1.797693135e+308, Minimum=-1.797693135e+308, TreeAccess=False)
tile_h = GetNumber(AtLeast=1, AtMost=1, Maximum=1.797693135e+308, Minimum=-1.797693135e+308, TreeAccess=False)
archetype_id = GetInteger(AtLeast=1, AtMost=1, Maximum=2147483647, Minimum=-2147483648, TreeAccess=False)
frame_t = GetNumber(AtLeast=1, AtMost=1, Maximum=1.797693135e+308, Minimum=-1.797693135e+308, TreeAccess=False)
bar_t = GetNumber(AtLeast=1, AtMost=1, Maximum=1.797693135e+308, Minimum=-1.797693135e+308, TreeAccess=False)
ring_t = GetNumber(AtLeast=1, AtMost=1, Maximum=1.797693135e+308, Minimum=-1.797693135e+308, TreeAccess=False)
corner_id = GetInteger(AtLeast=1, AtMost=1, Maximum=2147483647, Minimum=-2147483648, TreeAccess=False)
theta_deg = GetNumber(AtLeast=1, AtMost=1, Maximum=1.797693135e+308, Minimum=-1.797693135e+308, TreeAccess=False)
python_3_script = Python3Script(
    face_plane=face_plane,
    tile_w=tile_w,
    tile_h=tile_h,
    archetype_id=archetype_id,
    frame_t=frame_t,
    bar_t=bar_t,
    ring_t=ring_t,
    corner_id=corner_id,
    theta_deg=theta_deg)  # -> metrics_json, signature_raw, preview_crv
# ---------- python_3_script: Python ----------
import math, json
import Rhino.Geometry as rg

# -------- helpers --------
def clamp(x, lo, hi): 
    return max(lo, min(hi, x))

def r(x, n): 
    return round(float(x), n)

def valid_inputs(w,h,ft,bt,rt):
    if w<=0 or h<=0: return False, "non-positive size"
    if ft<0 or bt<0 or rt<0: return False, "negative thickness"
    if 2*ft >= min(w,h): return False, "frame too thick"
    return True, ""

# -------- inputs --------
w = float(tile_w); h = float(tile_h)
ft = float(frame_t); bt = float(bar_t); rt = float(ring_t)
aid = int(archetype_id); cid = int(corner_id) % 4
theta = math.radians(float(theta_deg))

# -------- validation --------
ok,msg = valid_inputs(w,h,ft,bt,rt)
if not ok:
    data = {
        "is_valid": False, "reason": msg,
        "panel_area": 0.0, "cut_length": 0.0,
        "void_ratio": 1.0, "fold_count": 0,
        "signature_raw": ""
    }
    metrics_json = json.dumps(data)
    signature_raw = ""
    preview_crv = []
else:
    # example simple geometry: rectangle
    rect = rg.Rectangle3d(face_plane, w, h)
    preview_crv = [rect.ToNurbsCurve()]

    data = {
        "is_valid": True, "reason": "",
        "panel_area": w*h, "cut_length": 2*(w+h),
        "void_ratio": 0.5, "fold_count": 2,
        "signature_raw": "ABC123"
    }
    metrics_json = json.dumps(data)
    signature_raw = data["signature_raw"]
# ---------- end python_3_script ----------
context_print = ContextPrint(Metrics_json=python_3_script.metrics_json)
context_print_2 = ContextPrint(Signature_raw=python_3_script.signature_raw)
preview_crv = GetGeometry(
    python_3_script.preview_crv,
    AnnotationTypeFilter=3966,
    AtLeast=1,
    AtMost=1,
    DeleteInput=False,
    Filter=1074081855,
    TreeAccess=False)
